# Grasshopper definition Python Test.gh (Grasshopper 0.9.14)
# plug-ins: Python Interpreter

slider = Slider(0.25, range=0..1)
slider_2 = Slider(5.224, range=0..10)
pt = Point(<point referenced from the Rhino model>)
pt_2 = Point(<point referenced from the Rhino model>)
pt_3 = Point(<point referenced from the Rhino model>)
python = PythonScript(Pt1=pt_3, Pt2=pt, Pt3=pt_2)  # -> line
# ---------- python: Python ----------
#Probando python in grasshopper

import rhinoscriptsyntax as rs
import math as mt


#User comunication module 
def imput(): 
    #Pedimos dos puntos para linea base y un angulo de rotacion recursiva
    l1 = rs.AddLine(Pt1,Pt2)
    l2 = rs.AddLine(Pt2,Pt3)
    #Calculamos el angulo de giro recursivo
    dblAngle = rs.Angle2(l1,l2)
    #Calculamos la longitud inicial dada por el usuario
    initialLength = rs.CurveLength(l1)
    #Definimos una reduccion por salto
    ScaleFactor = rs.GetReal("Jump factor scale",.8)
    #Establecemos un punto de rotura
    deadLength = rs.GetReal("Set tree dead length",3)
    
    recursion (l1,dblAngle,ScaleFactor,initialLength,deadLength)
    
    
def recursion (line,angle,scale,dista,distb):
    #Analizo la linea
    pointStart = rs.CurveStartPoint(line)
    pointEnd = rs.CurveEndPoint(line)
    dist = rs.CurveLength(line)
    #obtengo su vector
    vc1 = rs.VectorCreate(pointEnd,pointStart)
    vc2 = rs.VectorScale(vc1,scale)
    vector = rs.VectorRotate(vc2,angle[0],(0,0,1))
    #Lanzo dos puntos
    pointv1 = rs.PointAdd(pointEnd,vector)
    pointv2 = rs.PointAdd(pointEnd,-vector)
    #Incorporo nuevas lineas
    lv1 = rs.AddLine(pointEnd,pointv1)
    lv2 = rs.AddLine(pointEnd,pointv2)
    #Punto de rotura
    if dist>distb:
        recursion(lv1,angle,scale,dist,distb)
        recursion(lv2,angle,scale,dist,distb)
    
    
imput()
# ---------- end python ----------
