# Grasshopper definition ghpython_Ángel_001.gh (Grasshopper 0.9.14)
# plug-ins: Python Interpreter

pt = PointXYZ(XComponent=0, YComponent=0, ZComponent=0, System=PlaneXY(0, 0, 0))
a2 = Slider(50.3, range=0..360)
iterations = Slider(7, range=1..15)
length = Slider(7.2, range=0.1..10)
a1 = Slider(80.5, range=0..360)
python = PythonScript(Pto=pt, L=length, Ang1=a1, Ang2=a2, It=iterations)  # -> out, Pt
# ---------- python: Python ----------
import rhinoscriptsyntax as rs
import math as m
import Rhino.Geometry.Line as l
pts = []

def tree(point,length,a1,a2,iterations):
    PtM = rs.PointAdd(point,(length*m.cos(m.radians(a1)),length*m.sin(m.radians(a1)),0))
    Pt1 = rs.PointAdd(PtM,(length*m.cos(m.radians(a1+a2)),length*m.sin(m.radians(a1+a2)),0))
    Pt2 = rs.PointAdd(PtM,(length*m.cos(m.radians(a1-a2)),length*m.sin(m.radians(a1-a2)),0))

    if iterations>0:
        iterations -= 1
        tree(Pt1,length/1.2,a1,a2,iterations)
        tree(Pt2,length/1.2,a1,a2,iterations)
    pts.extend([PtM,Pt1,Pt2])

tree(Pto,L,Ang1,Ang2,It)
#Pt = tree(Pto,L,Ang1,Ang2,It)
Pt = pts
# ---------- end python ----------
panel = Panel(python.out)
