# Grasshopper definition ghpython_Ángel_002.gh (Grasshopper 0.9.14)
# plug-ins: Python Interpreter

pt = PointXYZ(XComponent=0, YComponent=0, ZComponent=0, System=PlaneXY(0, 0, 0))
a2 = Slider(40.6, range=0..360)
iterations = Slider(2, range=1..15)
length = Slider(3.9, range=0.1..10)
a1 = Slider(90.1, range=0..360)
python = PythonScript(Pto=pt, L=length, Ang1=a1, Ang2=a2, It=iterations)  # -> out, Pt; inputs Pto: Point3d
# ---------- python: Python ----------
import rhinoscriptsyntax as rs
import math as m
import Rhino.Geometry as rg
pts = []

def tree(point,length,a1,a2,iterations):
    PtM = rs.PointAdd(point,(length*m.cos(m.radians(a1)),length*m.sin(m.radians(a1)),0))
    Pt1 = rs.PointAdd(PtM,(length*m.cos(m.radians(a1+a2)),length*m.sin(m.radians(a1+a2)),0))
    Pt2 = rs.PointAdd(PtM,(length*m.cos(m.radians(a1-a2)),length*m.sin(m.radians(a1-a2)),0))
    l0 = rg.Line(point,PtM)
    #Problema con rg.Line al procesar "point" dice que es un GUI.
    l1 = rg.Line(PtM,Pt1)
    l2 = rg.Line(PtM,Pt2)
    if iterations>0:
        iterations -= 1
        tree(Pt1,length/1.2,a1,a2,iterations)
        tree(Pt2,length/1.2,a1,a2,iterations)
    pts.extend([l0,l1,l2])

tree(Pto,L,Ang1,Ang2,It)
Pt = tree(Pto,L,Ang1,Ang2,It)
# ---------- end python ----------
python_2 = PythonScript()  # -> out, a
# ---------- python_2: Python ----------
"""Constructs a recursive Koch curve.
    Inputs:
        x: The original line. (Line)
        y: The the number of subdivisions. (int)
    Outputs:
        a: The Koch curve, as a list of lines.
"""
import Rhino.Geometry as rg
import math


def Main():
    global a # as usual, you can assign to the global scope with the "global" keyword
    a = []
    SubdivideAndRotate(x, 0)

def WeightedAvaragePts(pt1, pt2, pt1_part):
    rest = 1 - pt1_part
    return pt1 * rest + pt2 * pt1_part

def SubdivideAndRotate(line, level):
    if level == y:
        a.append(line)
        return
    
    f = line.From #you can use "rg.Line." for exploring methods
    t = line.To
    b = WeightedAvaragePts(f, t, 1.0 / 3.0)
    c = WeightedAvaragePts(f, t, 2.0 / 3.0)
    
    m = WeightedAvaragePts(f, t, 0.5)
    bm = m - b
    
    e1 = bm / math.cos(angle)
    e1.Rotate(angle, rg.Vector3d(0,0,1))
    e = e1 + b
    
    level += 1
    
    SubdivideAndRotate(rg.Line(f, b), level)
    SubdivideAndRotate(rg.Line(b, e), level)
    SubdivideAndRotate(rg.Line(e, c), level)
    SubdivideAndRotate(rg.Line(c, t), level)

if x is None: x = rg.Line(rg.Point3d(0,0,0), rg.Point3d(10,10,0))
if y is None: y = 4
angle = math.pi / 3

Main()
# ---------- end python_2 ----------
panel = Panel(python.out)
