# Grasshopper definition ghpython_Ángel_003.gh (Grasshopper 0.9.14)
# plug-ins: Python Interpreter

pt = PointXYZ(XComponent=0, YComponent=0, ZComponent=0, System=PlaneXY(0, 0, 0))
length = Slider(2.4, range=0.1..10)
a1 = Slider(90, range=0..360)
a2 = Slider(49.9, range=0..360)
iterations = Slider(9, range=1..15)
python = PythonScript(Pto=pt, L=length, Ang1=a1, Ang2=a2, It=iterations)  # -> out, Pt; inputs Pto: Point3d
# ---------- python: Python ----------
import rhinoscriptsyntax as rs
import math as m
import Rhino.Geometry as rg
pts = []

def tree(point,length,a1,a2,iterations):
    PtM = rs.PointAdd(point,(length*m.cos(m.radians(a1)),length*m.sin(m.radians(a1)),0))
    Pt1 = rs.PointAdd(PtM,(length*m.cos(m.radians(a1+a2)),length*m.sin(m.radians(a1+a2)),0))
    Pt2 = rs.PointAdd(PtM,(length*m.cos(m.radians(a1-a2)),length*m.sin(m.radians(a1-a2)),0))
    l0 = rg.Line(point,PtM)
    #Problema con rg.Line al procesar "point" dice que es un GUI.
    l1 = rg.Line(PtM,Pt1)
    l2 = rg.Line(PtM,Pt2)
    if iterations>0:
        iterations -= 1
        tree(Pt1,length/1.4,a1/1.1,a2/1.1,iterations)
        tree(Pt2,length/1.4,a1/1.1,a2/1.1,iterations)
    pts.extend([l0,l1,l2])

tree(Pto,L,Ang1,Ang2,It)
Pt = pts
# ---------- end python ----------
