# Grasshopper definition ghpython_Ángel_006.gh (Grasshopper 0.9.14)
# plug-ins: Python Interpreter

series = Series(Start=0, Step=Slider(10, range=1..15), Count=10)
timer = Timer(TimerInterval=1000)
length = Slider(1.9, range=0.1..10)
a1 = Slider(90, range=0..360)
a2 = Slider(41.9, range=0..360)
r1 = Slider(4.1, range=-5..5)
r2 = Slider(-0.7, range=-5..5)
sr = Slider(1.4, range=1..5)
iterations = Slider(8, range=1..15)
pt = PointXYZ(XComponent=series, YComponent=0, ZComponent=0, System=PlaneXY(0, 0, 0))
python = PythonScript(Pto=pt, L=length, Ang1=a1, Ang2=a2, AngRat1=r1, AngRat2=r2, ScaleRat=sr, It=iterations)  # -> out, Pt; inputs Pto: Point3d
# ---------- python: Python ----------
import rhinoscriptsyntax as rs
import math as m
import Rhino.Geometry as rg
import random as rd
pts = []

def tree(point,length,a1,a2,iterations):
    PtM = rs.PointAdd(point,(length*m.cos(m.radians(a1)),length*m.sin(m.radians(a1)),0))
    Pt1 = rs.PointAdd(PtM,(length*m.cos(m.radians(a1+a2)),length*m.sin(m.radians(a1+a2)),0))
    Pt2 = rs.PointAdd(PtM,(length*m.cos(m.radians(a1-a2)),length*m.sin(m.radians(a1-a2)),0))
    l0 = rg.Line(point,PtM)
    #Problema con rg.Line al procesar "point" dice que es un GUI.
    l1 = rg.Line(PtM,Pt1)
    l2 = rg.Line(PtM,Pt2)
    choiceA = rd.randint(0,100)
    if iterations>0 and choiceA>=10:
        iterations -= 1
        choiceB1 = rd.randint(0,100)
        choiceB2 = rd.randint(0,100)
        if choiceB1 > ((iterations/It)*100)-70:
            tree(Pt1,length/ScaleRat,a1+AngRat1,a2+AngRat2,iterations)
        if choiceB2 > ((iterations/It)*100)-70:
            tree(Pt2,length/ScaleRat,a1+AngRat1,a2+AngRat2,iterations)
    pts.extend([l0,l1,l2])

tree(Pto,L,Ang1,Ang2,It)
Pt = pts
# ---------- end python ----------
