# Grasshopper definition closest_point_bundling.gh (Grasshopper 0.9.66)
# plug-ins: Python Interpreter

# ---- group: Closest Point Algorithm
crv = Curve([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])
lng = ListLength(List=crv)
series = Series(Start=0, Step=1, Count=lng)
num = Number(Slider(20, range=0..30))
cull_i = CullIndex(List=crv, Indices=graft(series), Wrap=True)  # -> simplify(List)
graft = GraftTree(Tree=crv, IncludeEmptyLists=True, IncludeNullItems=True)  # -> simplify(Tree)
divide = DivideCurve(Curve=graft, Count=num, Kinks=False)  # -> simplify(Points), Tangents, Parameters
divide_2 = DivideCurve(Curve=cull_i, Count=num, Kinks=False)  # -> Points, Tangents, Parameters
pshift = ShiftPaths(Data=divide_2.Points, Offset=-1)
cp = ClosestPoint(Point=divide.Points, Cloud=pshift)  # -> ClosestPoint, CPIndex, Distance
vec2pt = Vector2Pt(PointA=divide.Points, PointB=cp.ClosestPoint, Unitize=False)  # -> Vector, Length
eval = Evaluate(F="if(1/(x)<1,1/(x),1)", x=vec2pt.Length)
multiplication = Multiplication(A=vec2pt.Vector, B=eval)
move = Move(Geometry=divide.Points, Motion=multiplication)  # -> Geometry, Transform
nurbs = NurbsCurve(Vertices=move.Geometry, Degree=3, Periodic=False)  # -> Curve, Length, Domain

# ---- group: Copy-Paste Iteration
number_slider = Slider(28, range=0..30)
crv_2 = Curve([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])
cluster = Cluster(crv=crv_2, num=number_slider)  # -> flatten(C)
cluster_2 = Cluster(crv=cluster, num=number_slider)  # -> flatten(C)
cluster_3 = Cluster(crv=cluster_2, num=number_slider)  # -> flatten(C)
cluster_4 = Cluster(crv=cluster_3, num=number_slider)  # -> flatten(C)
cluster_5 = Cluster(crv=cluster_4, num=number_slider)  # -> flatten(C)
cluster_6 = Cluster(crv=cluster_5, num=number_slider)  # -> flatten(C)

# ----
crv_3 = Curve([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])
python = PythonScript(x=crv_3, y=Slider(20, range=0..30), z=Slider(5, range=0..30))  # -> out, a; inputs x: list of Curve, y: Int32, z: Int32
# ---------- python: Python ----------
import ghpythonlib.components as ghcomp
#create a list to store the new curves

def moveTowardsClosestPt(p,otherPts):
    closestPoint = ghcomp.ClosestPoint(p,otherPts)[0]
    vectorBetween = ghcomp.Vector2Pt(p,closestPoint,False)
    scaleFactor = 1
    if(vectorBetween[1]>1):scaleFactor = 1/vectorBetween[1]
    return ghcomp.Move(p,ghcomp.Multiplication(vectorBetween[0],scaleFactor))[0]

#Write bundling function like GH
def bundleCurves(curves):
    #store the curves
    newCurves = []
    #loop through the curves
    for c in curves:
        #divide the curve
        ptsOnCurve = ghcomp.DivideCurve(c,y,False)[0]
        searchPts = []
        #divide all the other curves and store the pts
        for o in curves:
            if(o is not c):
                searchPts.extend(ghcomp.DivideCurve(o,y,False)[0])
        #move all the points using our other function
        newCurvePts = []
        for p in ptsOnCurve:
            newCurvePts.append(moveTowardsClosestPt(p,searchPts))
        newCurves.append(rg.NurbsCurve.Create(False,3,newCurvePts))
    return newCurves

a=bundleCurves(x)
# ---------- end python ----------

# ==== cluster Cluster
num = ClusterInput()
crv = ClusterInput()
crv_2 = Curve(crv)
num_2 = Number(num)
lng = ListLength(List=crv_2)
series = Series(Start=0, Step=1, Count=lng)
cull_i = CullIndex(List=crv_2, Indices=graft(series), Wrap=True)  # -> simplify(List)
graft = GraftTree(Tree=crv_2, IncludeEmptyLists=True, IncludeNullItems=True)  # -> simplify(Tree)
divide = DivideCurve(Curve=graft, Count=num_2, Kinks=False)  # -> simplify(Points), Tangents, Parameters
divide_2 = DivideCurve(Curve=cull_i, Count=num_2, Kinks=False)  # -> Points, Tangents, Parameters
pshift = ShiftPaths(Data=divide_2.Points, Offset=-1)
cp = ClosestPoint(Point=divide.Points, Cloud=pshift)  # -> ClosestPoint, CPIndex, Distance
vec2pt = Vector2Pt(PointA=divide.Points, PointB=cp.ClosestPoint, Unitize=False)  # -> Vector, Length
eval = Evaluate(F="if(1/(x)<1,1/(x),1)", x=vec2pt.Length)
multiplication = Multiplication(A=vec2pt.Vector, B=eval)
move = Move(Geometry=divide.Points, Motion=multiplication)  # -> Geometry, Transform
nurbs = NurbsCurve(Vertices=move.Geometry, Degree=3, Periodic=False)  # -> Curve, Length, Domain
C = ClusterOutput(nurbs.Curve)
