# Grasshopper definition curve_division_003.gh (Grasshopper 0.9.75)
# plug-ins: Python Interpreter

crv = Curve(graft([<curve referenced from the Rhino model> x2]))
crv_2 = Curve(reparameterize(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))
crv_3 = Curve(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)
number_slider = Slider(2.8, range=0..15)
functions = PythonScript(
    curve=crv_2,
    dist=Slider(0.7, range=0..15),
    step=Slider(0.12, range=0.01..0.5),
    tolerance=Slider(0.001, range=0.001..0.1))  # -> out, a
# ---------- functions: Python ----------
#Iterative curve division

import rhinoscriptsyntax as rs
import Rhino.Geometry as rg

def divideCurve(crv,length):

    result = []
    
    leftover = distEndPt(crv)
    counter = 0
    
    #CoerCrv = rs.coercegeometry(crv)
    
    while leftover >= length:
        CoerCrv = rs.coercegeometry(crv)
        
        newPt = rs.CurveArcLengthPoint(CoerCrv,length)
        newPar = rs.CurveClosestPoint(CoerCrv,newPt)
        print CoerCrv
        print crv
        newCurves = rs.SplitCurve(crv,newPar)
        
        c = longestCurve(newCurves)
        crv = c
        leftover = distEndPt(c)
        counter += 1
        print counter
           
    result = [counter,leftover]
    return result
    
def longestCurve(crvs):
    len = 0
    for curve in crvs:
        newlen = rs.CurveLength(curve)
        if len < newlen:
            len = newlen
            curveReturn = curve
                
    return curveReturn              
    
def distEndPt(crv):
    pt0 = rs.CurveEndPoint(crv)
    pt1 = rs.CurveStartPoint(crv)
    return rs.Distance(pt0,pt1)

def flipCurves(crvs):
    
    newCrvs = []

    #Flipping curves to make them start at the midle point
    for crv in crvs:
        startPt = rs.CurveStartPoint(crv)
        compare = rs.PointCompare(m1,startPt)
        if not compare:
            rs.ReverseCurve(crv)
            newCrvs.append(crv)
        else:
            newCrvs.append(crv)
            
    return newCrvs           

m1 = rs.CurveMidPoint(curve)

##########BISECTION SEARCH

#Divide curves.
closestM1 = rs.CurveClosestPoint(curve,m1)
crvs = rs.SplitCurve(curve,closestM1)
newCrvs = flipCurves(crvs)

#Dividing the curves and measuring the left over
leftovers = []

for i in range(len(newCrvs)):
    divResult = divideCurve(newCrvs[i],dist)
    leftovers.append(divResult[1])
    
a = leftovers
# ---------- end functions ----------
eval = EvaluateLength(Curve=crv, Length=Slider(0.5, range=0..1), Normalized=True)  # -> Point, Tangent, Parameter
bisect_div = PythonScript(curve=crv_3, dist=Slider(11.8, range=0..15), tolerance=Slider(0.1, range=0.001..0.1), maxSteps=Slider(3, range=1..1000))  # -> out, t, i
# ---------- bisect_div: Python ----------
#Iterative curve division

import rhinoscriptsyntax as rs
import Rhino.Geometry as rg

def divideCurve(crv,length):

    result = []
    
    leftover = distEndPt(crv)
    counter = 0
    
    #CoerCrv = rs.coercegeometry(crv)
    
    while leftover >= length:
        
        newPt = rs.CurveArcLengthPoint(crv,length)
        newPar = rs.CurveClosestPoint(crv,newPt)
        newCurves = rs.SplitCurve(crv,newPar,False)
        
        c = longestCurve(newCurves)
        crv = c
        leftover = distEndPt(c)
        counter += 1
    
    print counter
    result = [counter,leftover]
    return result
    
def longestCurve(crvs):
    len = 0
    for curve in crvs:
        newlen = rs.CurveLength(curve)
        if len < newlen:
            len = newlen
            curveReturn = curve
                
    return curveReturn              
    
def distEndPt(crv):
    pt0 = rs.CurveEndPoint(crv)
    pt1 = rs.CurveStartPoint(crv)
    return rs.Distance(pt0,pt1)

def flipCurves(crvs,origCrv):
    m1 = rs.CurveMidPoint(origCrv)
    newCrvs = []
    #Flipping curves to make them start at the midle point
    for crv in crvs:
        startPt = rs.CurveStartPoint(crv)
        compare = rs.PointCompare(m1,startPt)
        if not compare:
            rs.ReverseCurve(crv)
            newCrvs.append(crv)
        else:
            newCrvs.append(crv)
            
    return newCrvs           
    
def customSplitCrvs(crv,param):
    
    CoerCrv = rs.coercegeometry(crv)

    crvs = rs.SplitCurve(crv,param,False)
    newCrvs = flipCurves(crvs,crv)
    return newCrvs

#Taking initial curve domain to test
crvDom = rs.CurveDomain(curve)
print crvDom
dblMin = crvDom[0]
dblMax = crvDom[1]

dblCheck = dblMax
dblIncr = dblMax/2
dblCheck -= dblIncr

##########BISECTION SEARCH
guess = False
counter = 0
#curveCoer = rs.coercegeometry(curve)

while not guess:
    #Divide curves.
    ###NOT NECESSARY### closestM1 = rs.CurveClosestPoint(curve,m1)

    newCrvs = customSplitCrvs(curve,dblCheck)

    #Dividing the curves and measuring the left over
    leftovers = []
    for i in range(len(newCrvs)):
        divResult = divideCurve(newCrvs[i],dist)
        leftovers.append(divResult[1])
    
    dblError = abs(leftovers[0]-leftovers[1])
    
    print dblError
    
    if leftovers[0]<leftovers[1] and dblError > tolerance:
        dblMax = dblCheck
           
    elif leftovers[0]>leftovers[1] and dblError > tolerance:     
        dblMin = dblCheck
        
    elif counter > maxSteps or dblError <= tolerance:
        result = dblCheck
        guess = True
        
    dblCheck = (dblMax-dblMin)/2       
    counter += 1
    
t = result
i = counter
# ---------- end bisect_div ----------
shatter = Shatter(Curve=crv, Parameters=eval.Parameter)
eval_2 = EvaluateCurve(Curve=crv_3, Parameter=bisect_div.t)  # -> Point, Tangent, Angle
division = Division(A=number_slider, B="2")
panel = Panel(functions.a)
rec = DataRecorder(bisect_div.i, DataLimit=-10, RecordData=True)
rec_2 = DataRecorder(bisect_div.t, DataLimit=-10, RecordData=True)
dispatch = Dispatch(List=shatter, DispatchPattern=[True, False])  # -> ListA, ListB
cset = CreateSet(List=rec_2)  # -> Set, Map
cset_2 = CreateSet(List=rec)  # -> Set, Map
flip = FlipCurve(Curve=dispatch.ListA)  # -> Curve, Flag
circle = CircleCNR(Center=eval.Point, Normal=Vector(0, 0, 1), Radius=division)
panel_2 = Panel(cset.Set)
panel_3 = Panel(cset_2.Set)
merge = Merge(Data1=flip.Curve, Data2=dispatch.ListB)  # -> simplify(Result)
ccx = CurveCurve(CurveA=merge, CurveB=circle)  # -> Points, simplify(ParamsA), ParamsB
shatter_2 = Shatter(Curve=graft(merge), Parameters=ccx.ParamsA)
item = ListItem(List=shatter_2, Index=0, Wrap=True)  # -> Item, Item1
divdist = DivideDistance(Curve=item.Item1, Distance=number_slider)  # -> Points, Tangents, Parameters
