# Grasshopper definition curve_division_004.gh (Grasshopper 0.9.75)
# plug-ins: Python Interpreter

number_slider = Slider(0.5, range=0..1)
crv = Curve(graft([<curve referenced from the Rhino model> x2]))
crv_2 = Curve(reparameterize(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))
crv_3 = Curve(<curve referenced from the Rhino model>)
file = ReadFile(File="F:\003_CODE\Git\Ejercicios\13_BinarySearch & Curve division\curve_division.py", PerLineParse=False)
number_slider_2 = Slider(2.8, range=0..15)
functions = PythonScript(
    curve=crv_2,
    dist=Slider(0.7, range=0..15),
    step=Slider(0.12, range=0.01..0.5),
    tolerance=Slider(0.001, range=0.001..0.1))  # -> out, a
# ---------- functions: Python ----------
#Iterative curve division

import rhinoscriptsyntax as rs
import Rhino.Geometry as rg

def divideCurve(crv,length):

    result = []
    
    leftover = distEndPt(crv)
    counter = 0
    
    #CoerCrv = rs.coercegeometry(crv)
    
    while leftover >= length:
        CoerCrv = rs.coercegeometry(crv)
        
        newPt = rs.CurveArcLengthPoint(CoerCrv,length)
        newPar = rs.CurveClosestPoint(CoerCrv,newPt)
        print CoerCrv
        print crv
        newCurves = rs.SplitCurve(crv,newPar)
        
        c = longestCurve(newCurves)
        crv = c
        leftover = distEndPt(c)
        counter += 1
        print counter
           
    result = [counter,leftover]
    return result
    
def longestCurve(crvs):
    len = 0
    for curve in crvs:
        newlen = rs.CurveLength(curve)
        if len < newlen:
            len = newlen
            curveReturn = curve
                
    return curveReturn              
    
def distEndPt(crv):
    pt0 = rs.CurveEndPoint(crv)
    pt1 = rs.CurveStartPoint(crv)
    return rs.Distance(pt0,pt1)

def flipCurves(crvs):
    
    newCrvs = []

    #Flipping curves to make them start at the midle point
    for crv in crvs:
        startPt = rs.CurveStartPoint(crv)
        compare = rs.PointCompare(m1,startPt)
        if not compare:
            rs.ReverseCurve(crv)
            newCrvs.append(crv)
        else:
            newCrvs.append(crv)
            
    return newCrvs           

m1 = rs.CurveMidPoint(curve)

##########BISECTION SEARCH

#Divide curves.
closestM1 = rs.CurveClosestPoint(curve,m1)
crvs = rs.SplitCurve(curve,closestM1)
newCrvs = flipCurves(crvs)

#Dividing the curves and measuring the left over
leftovers = []

for i in range(len(newCrvs)):
    divResult = divideCurve(newCrvs[i],dist)
    leftovers.append(divResult[1])
    
a = leftovers
# ---------- end functions ----------
eval = EvaluateLength(Curve=crv, Length=number_slider, Normalized=True)  # -> Point, Tangent, Parameter
bisect_div = PythonScript(
    Code=file,
    Curve=crv_3,
    Dist=Slider(4.3, range=0..15),
    Tolerance=Slider(0.046, range=0.001..0.1),
    MaxSteps=Slider(7, range=1..1000))  # -> Out, T, I, Pts
shatter = Shatter(Curve=crv, Parameters=eval.Parameter)
eval_2 = EvaluateCurve(Curve=reparameterize(crv_3), Parameter=number_slider)  # -> Point, Tangent, Angle
eval_3 = EvaluateCurve(Curve=crv_3, Parameter=bisect_div.T)  # -> Point, Tangent, Angle
panel = Panel(functions.a)
division = Division(A=number_slider_2, B="2")
dispatch = Dispatch(List=shatter, DispatchPattern=[True, False])  # -> ListA, ListB
panel_2 = Panel(bisect_div.T)
panel_3 = Panel(bisect_div.I)
flip = FlipCurve(Curve=dispatch.ListA)  # -> Curve, Flag
panel_4 = Panel(bisect_div.Out)
circle = CircleCNR(Center=eval.Point, Normal=Vector(0, 0, 1), Radius=division)
merge = Merge(Data1=flip.Curve, Data2=dispatch.ListB)  # -> simplify(Result)
ccx = CurveCurve(CurveA=merge, CurveB=circle)  # -> Points, simplify(ParamsA), ParamsB
shatter_2 = Shatter(Curve=graft(merge), Parameters=ccx.ParamsA)
item = ListItem(List=shatter_2, Index=0, Wrap=True)  # -> Item, Item1
divdist = DivideDistance(Curve=item.Item1, Distance=number_slider_2)  # -> Points, Tangents, Parameters
